# Grasshopper definition assignment_2b_recursion_branches_boxes.ghx (Grasshopper 1.0.7)

python = PythonScript(redraw=Button(), iterations=Slider(10, range=0..10))  # -> out, branches, boxes; inputs iterations: Int32
# ---------- python: Python ----------
# this creates random branching lines with recursion
# input type: line

import Rhino.Geometry as rg

from compas.geometry import Vector, Line, Point, Box, bounding_box
from compas.geometry import Rotation

from compas_ghpython.artists import PointArtist, LineArtist
from compas_ghpython import draw_frame

import random
import math


def recursiveLine(line, iterations, axis, lines, boxes):
    
    # count down the iterations
    'fill in here [...]'
    
    # get the start and end points of the input line
    'fill in here [...]'
    
    # get the vector of the input line, 2 times for the two branches
    'fill in here [...]'
    
    # rotate the vectors 90° in positive and negative direction around 2 axes
    R11 = Rotation.from_axis_and_angle(axis, math.pi/2)
    R12 = Rotation.from_axis_and_angle(line.vector, math.pi/2)
    R21 = Rotation.from_axis_and_angle(axis, -math.pi/2)
    R22 = Rotation.from_axis_and_angle(line.vector, math.pi/2)
    
    'fill in here [...]'
    
    # for the scale, calculate a random scale between 0.7 and 0.8
    scale1 = random.uniform(0.7, 0.8)
    scale2 = random.uniform(0.7, 0.8)

    # and scale the vector according to the scale values
    'fill in here [...]'
    
    # finally, create two new branches
    'fill in here [...]'
    
    # and add them to the list of branches
    'fill in here [...]'
   
    # create the normal vector using the cross product between the vector of the current line and dir1
    'fill in here [...]'
    
    # and unitize it
    'fill in here [...]'
    
    # calculate 4 corner points of the box
    pt1 = (start_point+dir1)+axis*dir1.length/2
    pt2 = 'fill in here [...]'
    pt3 = 'fill in here [...]'
    pt4 = 'fill in here [...]'
    
    # create a box around the lines
    # box = rg.Box(rg.Plane.WorldYZ, [pt1, pt2, pt3, pt4])
    bbox = bounding_box([pt1, pt4])
    box = Box.from_bounding_box(bbox)
    
    # and add them to the list of boxes
    'fill in here [...]'
    
    # if the iteration is higher than zero, keep calling the function recursively
    if iterations > 0:
        if(random.random() < 0.9): # random omission
            'fill in here [...]'
        if(random.random() < 0.9): # random omission
            'fill in here [...]'



# 1. input
line = Line(Point(0.,0.,0), Point(0.,0.,1.))
# line = RhinoLine.from_geometry(line).to_compas() #  convert Rhino Line to COMPAS line
axis = Vector(1.,0.,0.)

# 2. empty lists for start
branches = []
boxes = []

# 3. call the recursive function
recursiveLine(line, iterations, axis, branches, boxes)

# 4. convert the COMPAS geometry to the Rhino Geometry
def draw_box(b):
    plane = draw_frame(b.frame)
    vertices = [rg.Point3d(*list(v)) for v in b.vertices]
    rbox =  rg.Box(plane, vertices)
    return rbox

branches = [LineArtist(branch).draw() for branch in branches]
boxes = [draw_box(box) for box in boxes]
# ---------- end python ----------
line = Line(python.branches)
box = Box(python.boxes)
preview = CustomPreview(Geometry=box, Material=ColourSwatch(SwatchColor=RGB(255, 191, 191)))
